% Simulink data dictionary robotModelData.sldd
% references motorParametersData.sldd
% references kalmanParametersData.sldd

gyroToUnit = single(14.375)
accelToUnit = single(0.004)
PWMPeriod = single(0.1)
MaxMotorVoltage = single(9)

RobotVariantConfig = Simulink.VariantConfigurationData(
  struct(
    Configurations=struct(
      Name="RobotConfig",
      Description="",
      ControlVariables=[struct(
        Name="controlAlgCtrl",
        Value=Simulink.VariantControl(Value=1, ActivationTime="update diagram", ValueType="Numeric"),
        Source="robotModelData.sldd"), struct(
        Name="encoderDimCtrl",
        Value=Simulink.VariantControl(Value=1, ActivationTime="update diagram", ValueType="Numeric"),
        Source="robotModelData.sldd"), struct(
        Name="tiltEstCtrl",
        Value=Simulink.VariantControl(Value=1, ActivationTime="update diagram", ValueType="Numeric"),
        Source="robotModelData.sldd"), struct(
        Name="motorDimCtrl",
        Value=Simulink.VariantControl(Value=1, ActivationTime="update diagram", ValueType="Numeric"),
        Source="robotModelData.sldd")]),
    VariantConfigurations=struct(
      Name="RobotConfig",
      Description="",
      ControlVariables=[struct(
        Name="controlAlgCtrl",
        Value=Simulink.VariantControl(Value=1, ActivationTime="update diagram", ValueType="Numeric"),
        Source="robotModelData.sldd"), struct(
        Name="encoderDimCtrl",
        Value=Simulink.VariantControl(Value=1, ActivationTime="update diagram", ValueType="Numeric"),
        Source="robotModelData.sldd"), struct(
        Name="tiltEstCtrl",
        Value=Simulink.VariantControl(Value=1, ActivationTime="update diagram", ValueType="Numeric"),
        Source="robotModelData.sldd"), struct(
        Name="motorDimCtrl",
        Value=Simulink.VariantControl(Value=1, ActivationTime="update diagram", ValueType="Numeric"),
        Source="robotModelData.sldd")],
      SubModelConfigurations=[]),
    Constraints=[],
    PreferredConfiguration="",
    DefaultConfigurationName="",
    DataDictionaryName="",
    DataDictionarySection="",
    AreSubModelConfigurationsMigrated=true,
    ComponentConfigurationData=[],
    Version="24.1"))

wheelRadius = single(0.05)
CPR = 2184
wheelBase = single(0.15)
massOfCart = 0.2
massOfPendulum = 0.5
lengthToPendulumCenterOfMass = 0.2
inertiaOfPendulum = 0.06