% Simulink data dictionary variantControlsData.sldd

encoderDimCtrl = Simulink.VariantControl(Value=1, ActivationTime="update diagram", ValueType="Numeric")
tiltEstCtrl = Simulink.VariantControl(Value=2, ActivationTime="update diagram", ValueType="Numeric")
motorDimCtrl = Simulink.VariantControl(Value=1, ActivationTime="update diagram", ValueType="Numeric")
mainStateEstCtrl = Simulink.VariantControl(Value=2, ActivationTime="update diagram", ValueType="Numeric")
controlAlgCtrl = Simulink.VariantControl(Value=4, ActivationTime="update diagram", ValueType="Numeric")